# Dynamo graph script.dyn "BIM_DATA-MODEL-HEALTH-UPDATER" (Dynamo 2.16.2.5624)
# packages: Crumple 2021.9.24, Clockwork for Dynamo 2.x 2.6.0, archi-lab.net 2024.217.1024, Crumple 2022.5.27, Genius Loci 2022.1.5, Data-Shapes 2022.2.98, Rhythm 2023.9.1

# group: READ AND ADJUST VALUE PARAMETER WITHIN DIALS
fileSize = Custom[ActiveDocument.FileSize]()  # package Data-Shapes; Gets the file size of the ative document, even if it is a BIM360 Design workshared project.
# note: Where the numbers for the dial Value parameter is produced
fileSize_Integer = Watch(fileSize.1)
# note: Set the parameters for the dials with these lists:
# [1] = Variable for Dial Values
# [2] = Lower Limit
# [3] = Upper Limit
# [4] = Metric Name
file_size = CodeBlock(x=fileSize_Integer)
# ---------- file_size.designscript (4 lines) ----------
[Math.Ceiling(x),
0,
1000,
"File Size Mb"];
# ----------------------------------------
current = Document.Current()
# note: This column and the columns prior to this is where i get information from the active document.
getwarnings = Custom[© GetWarnings](docOrLink=current)  # package Crumple; Returns all warnings in the Revit model in their Revit db format.
count_warnings = List.Count(list=getwarnings)
warnings = CodeBlock(x=count_warnings)
# ---------- warnings.designscript (4 lines) ----------
[x,
0,
500,
"Total Warnings"];
# ----------------------------------------
worksets = Custom[© Worksets](docOrLink=current)  # package Crumple; Returns all user worksets and their names in a document.
count_worksets = List.Count(list=worksets.worksets)
worksets_2 = CodeBlock(x=count_worksets)
# ---------- worksets_2.designscript (4 lines) ----------
[x,
0,
20,
"Workset Count"];
# ----------------------------------------
false_only = CodeBlock { False; }  # unwired: False
purge_unused = Custom[Purge Unused](RunIt=false_only, Deeply=false_only, document=current)  # package Genius Loci; Purge the document completely including materials an assets using the API. The optional input "deeply" allows to purge unused view templates, unused view filters, imported line Patterns from DWG and "Imports in Families" Object Styles. Can be used with documents open in the background. Works only in Revit 2017 and later.
count_purgeable_elements = List.Count(list=purge_unused.Id)
purgable_elements = CodeBlock(x=count_purgeable_elements)
# ---------- purgable_elements.designscript (4 lines) ----------
[x,
0,
1500,
"Purgable Elements"];
# ----------------------------------------
collect_materials = Custom[© Collect.Materials](docOrLink=current)  # package Crumple; Returns all materials in the given document.
name = Material.Name(material=collect_materials.materials)
count_materials = List.Count(list=name)
material_count = CodeBlock(x=count_materials)
# ---------- material_count.designscript (4 lines) ----------
[x,
0,
1000,
"Material Count"];
# ----------------------------------------
views = Custom[© Views]()  # package Crumple; Returns all views in a document. Excludes system views, templates, legends and schedule instances.
isOnSheet = archilab.Revit.Views.Views.IsOnSheet(view=views)
counting_views = CodeBlock(views=views, views_sheeted_false=isOnSheet, views_sheeted_true=isOnSheet)
# ---------- counting_views.designscript (3 lines) ----------
view_count = DSCore.List.Count(views);
views_not_sheeted = DSCore.List.CountFalse(views_sheeted_false);
views_sheeted = DSCore.List.CountTrue(views_sheeted_true);
# ----------------------------------------
view_counts = CodeBlock(x=counting_views.views_not_sheeted)
# ---------- view_counts.designscript (4 lines) ----------
[x,
0,
500,
"Unsheeted Views"];
# ----------------------------------------
# note: Aggregate all data
# from the lists
list_create = List.Create(item0=file_size, item1=warnings, item2=worksets_2, item3=purgable_elements, item4=material_count, item5=view_counts)
index_picker = CodeBlock { [0]; [1]; [2]; [3]; }
# note: Gather all common data points into seperate lists.
# All values into 1 list, Lower Limits into 1 list, etc
value = List.GetItemAtIndex(list=list_create@L2, index=index_picker.out0)  # "List.Value"
lowerLimit = List.GetItemAtIndex(list=list_create@L2, index=index_picker.out1)  # "List.LowerLimit"
upperLimit = List.GetItemAtIndex(list=list_create@L2, index=index_picker.out2)  # "List.UpperLimit"
metricName = List.GetItemAtIndex(list=list_create@L2, index=index_picker.out3)  # "List.MetricName"
# note: This code block flattens the lists to go from
# 0.
#     0.
# 1.
#     0.
# 2..
# to this:
# 0.
#     0.
#     1.
# 1.
#     0.
#     1.
code_block = CodeBlock(value=value, LowerLimit=lowerLimit, UpperLimit=upperLimit, MetricName=metricName) { List.Flatten(value); List.Flatten(LowerLimit); List.Flatten(UpperLimit); List.Flatten(MetricName); }

# group: UI to inform User of Health Score
code_block_2 = CodeBlock { "Health Check Completed"; }
div = code_block.out0 / code_block.out2
is_x_1_true_0_false_turnto = CodeBlock(x=div) { x >= 1 ? 0 : Math.Round((x)*100); }  # "is X > 1? True=0 : False=TurnTo% #NUMBER"
is_x_0_true_fail_false_report = CodeBlock(x=is_x_1_true_0_false_turnto) { x == 0 ? ": FAIL" : ": " + Math.Floor(x) + "% of Cap"; }  # "is X = 0? True=Fail : False=Report Rounded % of Cap"
code_block_3 = CodeBlock(x=code_block.out3, y=is_x_0_true_fail_false_report) { x + y; "\n"; }
code_block_4 = CodeBlock(x=is_x_1_true_0_false_turnto) { x == 0 ? false : true; }
countFalse = List.CountFalse(list=code_block_4)
code_block_5 = CodeBlock(x=countFalse) { x >= 2 ? "Health Check Failed. Model Needs Attention" : "Health Check Passed!"; }
join = String.Join(separator=code_block_3.out1, string0=code_block_5, string1=code_block_3.out0)
uimessenger = Custom[© UIMessenger](title=code_block_2, body=join)  # package Crumple; Displays a message box with a title/body and OK/cancel button. If OK is selected, the third input's data will be passed through.

# group: GET DIAL FAMILIES & THEN RENAME
define_what_family_to_look_for = CodeBlock { "ANNO_G_Open-Close_Health-Dials"; "Warning Dials"; }
byFamilyNameAndTypeName = FamilyType.ByFamilyNameAndTypeName(familyName=define_what_family_to_look_for.out0, typeName=define_what_family_to_look_for.out1)
# note: Gather all the dials as instances
byFamilyType = FamilyInstance.ByFamilyType(familyType=byFamilyNameAndTypeName)
code_block_6 = CodeBlock { "Metric Name"; }
# note: Within all dial instances grab the parameter named "Metric Name".
# > Set dial parameter "Metric Name" to the values from the "Metric Name" values in the group below
setParameterByName = Element.SetParameterByName(element=byFamilyType, parameterName=code_block_6, value=code_block.out3)
# note: Wait for the "Metric Name" parameters to be set before continuing
waitFor_MetricNamesToBeSet = Custom[WaitFor_MetricNamesToBeSet](passThrough=setParameterByName, waitFor=setParameterByName)  # package Clockwork for Dynamo 2.x; Forces a sequential order of execution. The node wired into the output of the Passthrough node will be executed *after* the node wired into the waitFor input (e.g. important for some Revit operations). The value of the passThrough input will be passed on to the node wired into the output port of the Passthrough node.
waitFor_MetricNamesToBeSet_2 = Custom[WaitFor_MetricNamesToBeSet](passThrough=code_block_6, waitFor=setParameterByName)
# note: Once the dials have their Metric Name set, we get the names in a list to establish indexes. Establish the indexes because we use this index to assign the number values. This ensures we don't assign the wrong values to the metrics.
# TLDR: build index to make sure x = x and not x = y
getParameterValueByName = Element.GetParameterValueByName(element=waitFor_MetricNamesToBeSet, parameterName=waitFor_MetricNamesToBeSet_2)
# note: Once we have the index, we match the Metric Names with the Dials. Next step: apply values to these dial elements
indexOf = List.IndexOf(list=getParameterValueByName, element=code_block.out3)
itemAtIndex_Dials = List.GetItemAtIndex(list=waitFor_MetricNamesToBeSet, index=indexOf)  # "Get.ItemAtIndex_Dials"

# group: COMMIT DIAL CHANGES TO PARAMETERS: VALUE, LOWERS AND UPPERS
code_block_7 = CodeBlock { "Lower Limit"; }
lowers = Watch(code_block.out1)
itemAtIndex_Lower = List.GetItemAtIndex(list=lowers, index=indexOf)  # "Get.ItemAtIndex_Lower"
waitFor_MetricNamesToBeSet_3 = Custom[WaitFor_MetricNamesToBeSet](passThrough=itemAtIndex_Lower, waitFor=setParameterByName)
setParameterByName_2 = Element.SetParameterByName(element=itemAtIndex_Dials, parameterName=code_block_7, value=waitFor_MetricNamesToBeSet_3)  # graph output
code_block_8 = CodeBlock { "Upper Limit"; }
uppers = Watch(code_block.out2)
itemAtIndex_Upper = List.GetItemAtIndex(list=uppers, index=indexOf)  # "Get.ItemAtIndex_Upper"
waitFor_MetricNamesToBeSet_4 = Custom[WaitFor_MetricNamesToBeSet](passThrough=itemAtIndex_Upper, waitFor=setParameterByName)
setParameterByName_3 = Element.SetParameterByName(element=itemAtIndex_Dials, parameterName=code_block_8, value=waitFor_MetricNamesToBeSet_4)  # graph output
# note: search for these parameters within the dials
code_block_9 = CodeBlock { "Value"; }
value_variable = Watch(code_block.out0)
# note: Match the values, lowers and uppers with the proper dial via indexing
itemAtIndex_Values = List.GetItemAtIndex(list=value_variable, index=indexOf)  # "Get.ItemAtIndex_Values"
# note: wait for the dial metric names to be set before continuing
waitFor_MetricNamesToBeSet_5 = Custom[WaitFor_MetricNamesToBeSet](passThrough=itemAtIndex_Values, waitFor=setParameterByName)
setParameterByName_4 = Element.SetParameterByName(element=itemAtIndex_Dials, parameterName=code_block_9, value=waitFor_MetricNamesToBeSet_5)  # graph output

# group: GET WORKSET NAMES & BUILD LIST
worksets_3 = Custom[© Worksets]()
get_names_of_worksets_build = CodeBlock(names=worksets_3.names)  # "Get names of worksets, Build Workset List & Title"
# ---------- get_names_of_worksets_build.designscript (6 lines) ----------
WSNames = List.Sort(List.Flatten(names));
sep = "
";
WSList = (String.Join(sep, List.Sort(WSNames)));
WSTitle = "Worksets in Model:
";
# ----------------------------------------

# group: CREATE MODEL HEALTH NOTES
code_block_10 = CodeBlock { "ANNO_G_Open-Close-View"; }
byFamilyNameAndTypeName_2 = FamilyType.ByFamilyNameAndTypeName(familyName=code_block_10, typeName=code_block_10)
byFamilyType_2 = FamilyInstance.ByFamilyType(familyType=byFamilyNameAndTypeName_2)
ʳʰʸᵗʰᵐ_system_currentusername = Rhythm.Helpers.System.CurrentUserName()
code_block_11 = CodeBlock(User=ʳʰʸᵗʰᵐ_system_currentusername, PF_in=code_block_5, WSList_in=get_names_of_worksets_build.WSList, WSTitle_in=get_names_of_worksets_build.WSTitle)
# ---------- code_block_11.designscript (13 lines) ----------
//Parameters for labels in the Open/Close View
P0 = "LinkToSmartSheets";
P1 = "Output_DateTime";
P2 = "Output_PassFail";
P3 = "Output_WorksetList";
P4 = "Output_WorksetTitle";

//Outputs
Link = "https://app.smartsheet.com/browse/workspaces";
DateTime_out = "Health Check last ran by: " + User + " @ " + DateTime.Now;
PassFail_out = PF_in;
WSList_out = WSList_in;
WSTitle_out = WSTitle_in;
# ----------------------------------------
set_datetime = Element.SetParameterByName(element=byFamilyType_2, parameterName=code_block_11.P1, value=code_block_11.DateTime_out)  # graph output
set_passfail = Element.SetParameterByName(element=byFamilyType_2, parameterName=code_block_11.P2, value=code_block_11.PassFail_out)  # graph output
set_worksetlist = Element.SetParameterByName(element=byFamilyType_2, parameterName=code_block_11.P3, value=code_block_11.WSList_out)  # graph output
set_worksettitle = Element.SetParameterByName(element=byFamilyType_2, parameterName=code_block_11.P4, value=code_block_11.WSTitle_out)  # graph output
set_smartsheet_link = Element.SetParameterByName(element=byFamilyType_2, parameterName=code_block_11.P0, value=code_block_11.Link)  # graph output
