# Dynamo graph script.dyn (Dynamo 2.6.2.15705)

categories = Categories("OST_DetailComponents")
all_elements_of_category = ElementsOfCategory(Category=categories)
code_block = CodeBlock { "Region Area"; }
code_block_2 = CodeBlock { "Area"; }
getParameterValueByName = Element.GetParameterValueByName(element=all_elements_of_category, parameterName=code_block_2)
setParameterByName = Element.SetParameterByName(element=all_elements_of_category, parameterName=code_block, value=getParameterValueByName)
