# Dynamo graph script.dyn (Dynamo 2.6.1.8786)
# packages: Crumple 2021.9.24, Data-Shapes 2022.2.98, bimorphNodes 4.0.13, BumbleBee 2021.25.3

# group: Optional - Filter by Words
name = Element.Name()  # unwired: element
code_block = CodeBlock { true; }
contains = String.Contains(str=name, ignoreCase=code_block)  # unwired: searchFor
filterByBoolMask = List.FilterByBoolMask(mask=contains)  # unwired: list

code_block_2 = CodeBlock { 0; true; }
code_block_3 = CodeBlock { "SCRIPT COMPLETE"; }
code_block_4 = CodeBlock { "EXPORT SCHEUDLE"; "EXPORT"; "CANCEL"; 900; 600; 200; }
code_block_5 = CodeBlock { "SCHEDULE"; true; false; 400; }
schedulesbytype = Custom[© SchedulesByType]()  # package Crumple; Returns all schedules in a document, separated into key and non-key schedules.
name_2 = Element.Name(element=schedulesbytype.schedules)
listview_data = Custom[Listview Data](InputName=code_block_5.out0, Keys=name_2, Values=schedulesbytype.schedules, Height_optionnal=code_block_5.out3, HilightInView_optionnal=code_block_5.out2, DisplayModeOnly_optionnal=code_block_5.out2, ShowElementCount_optionnal=code_block_5.out2, SortItems_optionnal=code_block_5.out1, ShowId_optionnal=code_block_5.out2)  # package Data-Shapes; Create data for ListView input in UI.MultiInputForm ++ . Check out www.data-shapes.net for more infos.
code_block_6 = CodeBlock { "FILE PATH"; "Select a file path..."; }
filepath_data = Custom[FilePath Data](InputName=code_block_6.out0, ButtonText=code_block_6.out1)  # package Data-Shapes; Create filepath input for UI.MultipleInputForm ++ . Check out www.data-shapes.net for more infos !
list_create = List.Create(item0=listview_data, item1=filepath_data)
boolean = BoolSelector(true)
code_block_7 = CodeBlock { "https://erdmancompany.sharepoint.com/sites/vdc/SitePages/VDC-Training.aspx"; }
multipleinputform = Custom[MultipleInputForm ++](Description_optional=code_block_4.out0, ButtonText_optional=code_block_4.out1, Inputs=list_create, Toggle=boolean, LinkToHelp_optional=code_block_7, CancelButtonText_optional=code_block_4.out2, MaxHeight_optional=code_block_4.out3, Width_optional=code_block_4.out4, LabelWidth_optional=code_block_4.out5)  # package Data-Shapes; Create a form with multiple inputs. see www.data-shapes.net for tutorials and infos!
code_block_8 = CodeBlock(out=multipleinputform.User_Inputs) { sched = out[0]; path  = out[1]; }
boolean_2 = BoolSelector(true)
name_3 = Element.Name(element=code_block_8.sched)

# group: Remove forbidden characters
code_block_9 = CodeBlock { " "; ""; }
replace = String.Replace(str=name_3, searchFor=code_block_9.out0, replaceWith=code_block_9.out1)
code_block_10 = CodeBlock { "/"; ""; }
replace_2 = String.Replace(str=replace, searchFor=code_block_10.out0, replaceWith=code_block_10.out1)

# group: Limit excel sheet names to 31 characters
code_block_11 = CodeBlock { 0; }
length = String.Length(str=replace_2)
code_block_12 = CodeBlock(str=length) { str >= 31; }
code_block_13 = CodeBlock { 31; }
if_ = If(test=code_block_12, true=code_block_13, false=length)
substring = String.Substring(str=replace_2, startIndex=code_block_11, length=if_)

code_block_14 = CodeBlock { "A2"; }
boolean_3 = BoolSelector(false)
getData = Revit.Schedule.GetData(scheduleView=code_block_8.sched, refresh=boolean_3)
bb_data = Custom[BB Data](sheetName=substring, origin=code_block_14, data=getData@L4)  # package BumbleBee; This node is a building block for different modes of writing to Excel files. You can combines this node into a list to write to multiple sheets or use just one to write to a single sheet.
write_excel = Custom[Write Excel](filePath=code_block_8.path, runIt=boolean_2, BBData=bb_data)  # package BumbleBee; This node will write data to Excel file and based on how your BBData nodes are structured it will either override the exsting file, create a new one and write a single worksheet or write multiple worksheets.
uimessenger = Custom[© UIMessenger](title=code_block_3, body=write_excel)  # package Crumple; Displays a message box with a title/body and OK/cancel button. If OK is selected, the third input's data will be passed through.
