# Dynamo graph script.dyn (Dynamo 2.16.1.2727)
# packages: Data-Shapes 2022.2.98, Crumple 2021.9.24, Rhythm 2021.7.3

code_block = CodeBlock { "Upgrade Cancelled"; "The model upgrades were cancelled. No models were upgraded."; }
code_block_2 = CodeBlock()
# ---------- code_block_2.designscript (4 lines) ----------
"Upgrade Models in Directory Path to Current Revit Version";
"Upgrade Models    (Warning: This might take a while)";
"https://erdmancompany.sharepoint.com/sites/vdc/SitePages/VDC-Training.aspx";
"Cancel";
# ----------------------------------------
file_path = Filename("..\..\..\..\Jools-Logo.png")
code_block_3 = CodeBlock { "Directory Path:"; "Locate Folder with Outdated Rvt Models"; }
directorypath_data = Custom[DirectoryPath Data](InputName=code_block_3.out0, ButtonText=code_block_3.out1)  # package Data-Shapes; Creates a DirectoryPath input for UI.MultipleInputForm ++ . Check out www.data-shapes.net for more infos!
code_block_4 = CodeBlock { "Audit:"; "Check for Yes"; }
boolean_input = Custom[Boolean input](InputName=code_block_4.out0, SideText=code_block_4.out1)  # package Data-Shapes; Creates a boolean input for UI.MultipleInputForm ++ . Check out www.data-shapes.net for more infos!
code_block_5 = CodeBlock { "Detach From Central:"; "Check for Yes"; }
boolean_input_2 = Custom[Boolean input](InputName=code_block_5.out0, SideText=code_block_5.out1)
code_block_6 = CodeBlock { "Preserve Worksets:"; "Check for Yes"; }
boolean_input_3 = Custom[Boolean input](InputName=code_block_6.out0, SideText=code_block_6.out1)
code_block_7 = CodeBlock { "Close All Worksets:"; "Check for Yes"; }
boolean_input_4 = Custom[Boolean input](InputName=code_block_7.out0, SideText=code_block_7.out1)
code_block_8 = CodeBlock { "Unload All Links:"; "Check for Yes"; }
boolean_input_5 = Custom[Boolean input](InputName=code_block_8.out0, SideText=code_block_8.out1)
list_create = List.Create(item0=directorypath_data, item1=boolean_input, item2=boolean_input_2, item3=boolean_input_3, item4=boolean_input_4, item5=boolean_input_5)
boolean = BoolSelector(true)
code_block_9 = CodeBlock { 1500; 800; }
multipleinputform = Custom[MultipleInputForm ++](Description_optional=code_block_2.out0, Logo_optional=file_path, ButtonText_optional=code_block_2.out1, Inputs=list_create, Toggle=boolean, LinkToHelp_optional=code_block_2.out2, CancelButtonText_optional=code_block_2.out3, MaxHeight_optional=code_block_9.out0, Width_optional=code_block_9.out1)  # package Data-Shapes; Create a form with multiple inputs. see www.data-shapes.net for tutorials and infos!
uimessenger = Custom[© UIMessenger](title=code_block.out0, body=code_block.out1, pass=multipleinputform.Was_Cancelled)  # package Crumple; Displays a message box with a title/body and OK/cancel button. If OK is selected, the third input's data will be passed through.
code_block_10 = CodeBlock(IN=multipleinputform.User_Inputs) { IN[0]; IN[1]; IN[2]; IN[3]; IN[4]; IN[5]; }
directory_from_path = DirectoryObject(path=code_block_10.out0)
code_block_11 = CodeBlock { "*.rvt"; false; }
getDirectoryContents = FileSystem.GetDirectoryContents(directory=directory_from_path, searchString=code_block_11.out0, includeSubdirectories=code_block_11.out1)
ʳʰʸᵗʰᵐ_applications_upgradefile = Rhythm.Revit.Application.Applications.UpgradeFile(filePath=getDirectoryContents.files, audit=code_block_10.out1, detachFromCentral=code_block_10.out2, preserveWorksets=code_block_10.out3, closeAllWorksets=code_block_10.out4, unloadAllLinks=code_block_10.out5)
